# Grasshopper definition 20231125_RebarShape.gh (Grasshopper 1.0.7)
# plug-ins: Bifocals, ShapeDiverForGrasshopper

number_slider = Slider(253, range=0..1000)
b = Slider(398, range=0..1000)
c = Slider(246, range=0..1000)
d = Slider(323, range=0..1000)
e = Slider(172, range=0..1000)
f = Slider(250, range=0..1000)
g = Slider(200, range=0..1000)
h = Slider(196, range=0..1000)
number_slider_2 = Slider(0, range=0..100)
sddp = ShapeDiverDocumentPayload({AbsoluteTolerance=0, AngleTolerance=0, DistanceDisplayPrecision=0, GltfVersion="Gltf2", InputGroups="{}", OutputGroups="{}", RelativeTolerance=0, UnitSystem=0, VersionCreated="1.13.1.0", VersionSaved="1.13.1.0"})
gallery = ImageGallery(CycleDelay=30, Randomize=False, UseLocalImages=True, UseRemoteImages=True)
xy = XYPlane(Origin=Point(0, 0, 0))
list = ValueList({"00", "pm01", "pm02", "pm03", "02", "19", "20", "pm04", "06"}, selected="pm01")
panel = Panel(list)
neg = Negative(Value=g)
neg_2 = Negative(Value=f)
python = GhPythonScript(
    name=panel,
    p=xy,
    a=number_slider,
    b=b,
    c=c,
    d=d,
    e=e,
    f=neg_2,
    g=neg,
    h=h,
    x=number_slider_2,
    y=number_slider_2,
    j=number_slider_2)  # -> out, curve, hookAtStart, hookAtEnd, hookOrientationStart, hookOrientationEnd; inputs p: Plane
# ---------- python: Python ----------
from rebar.data_processor import find_row_by_name
from rebar.rebarShape  import RebarShapeCurve

print(name)
data= find_row_by_name(name)
print(data[0])
print(data[0]['RhinoBaseLineType'])
print(data[0]['LengthParameter'])
print(data[0]['Name'])

rgLineType = data[0]['RhinoBaseLineType']
length_parameters = data[0]['LengthParameter']
length_parameters = length_parameters.split(',')
# すべての可能なパラメータをNoneで初期化
params = {'a': None, 'b': None, 'c': None, 'd': None, 'e': None, 'f': None, 'g': None, 'h': None, 'x': None, 'y': None, 'j': None}

for param in length_parameters:
    params[param] = locals()[param]
    print(params[param])
    
curve = RebarShapeCurve(rgLineType, p, **params).curve
hookAtStart =data[0]['Hook At Start'] 
hookAtEnd =data[0]['Hook At End'] 
hookOrientationStart =data[0]['HookOrientatiotion0'] 
hookOrientationEnd =data[0]['HookOrientation1']
# ---------- end python ----------

# ----
# Color Format
# Input
data = Data(1)
# Method
data_2 = Data(1)
# Output
data_3 = Data(1)
# Display
data_4 = Data(1)
# Unuse
data_5 = Data(1)

python_2 = GhPythonScript(
    name="rg13",
    p=xy,
    a=number_slider,
    b=b,
    c=c,
    d=d,
    e=e,
    f=neg_2,
    g=neg,
    h=h,
    x=number_slider_2,
    y=number_slider_2,
    j=number_slider_2)  # -> out, curve; inputs p: Plane
# ---------- python_2: Python ----------
from rebar.rebarShape  import RebarShapeCurve

curve = RebarShapeCurve(name, p, a,b,c,d,e,f,g,h,x,y,j).curve
# ---------- end python_2 ----------
panel_2 = Panel(python.hookOrientationStart)
panel_3 = Panel(python.hookAtStart)
panel_4 = Panel(python.hookOrientationEnd)
panel_5 = Panel(python.hookAtEnd)
panel_6 = Panel(python_2.curve)
preview = CustomPreview(Geometry=python_2.curve, Material=ColourSwatch(SwatchColor=RGB(255, 0, 0)))
preview_2 = CustomPreview(Geometry=python.curve, Material=ColourSwatch(SwatchColor=RGB(250, 0, 0)))
