# Grasshopper definition 20231130_createRebar.gh (Grasshopper 1.0.7)
# Copyright: GEL
# plug-ins: Bifocals, Rhino.Inside for Autodesk Revit, ShapeDiverForGrasshopper

sddp = ShapeDiverDocumentPayload({AbsoluteTolerance=0, AngleTolerance=0, DistanceDisplayPrecision=0, GltfVersion="Gltf2", InputGroups="{}", OutputGroups="{}", RelativeTolerance=0, UnitSystem=0, VersionCreated="1.13.1.0", VersionSaved="1.13.1.0"})
gallery = ImageGallery(CycleDelay=30, Randomize=False, UseLocalImages=True, UseRemoteImages=True)

主筋 = Panel("ProgramInput_D-wall_Mainbar.csv")
csv = Panel("ProgramInput_D-wall_Starterbar.csv")
csv_2 = Panel("ProgramInput_D-wall_Distbar.csv")
ファルダ名 = Panel("data")
csv_3 = Panel("ProgramInput_D-wall_Stiffener.csv")
csv_4 = Panel("ProgramInput_D-wall_Shearlinks.csv")

create_rebar = BooleanToggle(False)

# ----
# Select Part
graphical_element = GraphicalElement(<wall referenced from the Revit model>)

# ----
# Select Ceiling
graphical_element_2 = GraphicalElement(<floor referenced from the Revit model>)

geometry = ElementGeometry(Elements=graphical_element)
geometry_2 = ElementGeometry(Elements=graphical_element_2)
bbox = BoundingBox(Content=geometry, Plane=PlaneXY(0, 0, 0))  # -> Box, Box_2
python = GhPythonScript(folder_name=ファルダ名, main_line=csv, x=Toggle(True))  # -> out, main_line_dir
# ---------- python: Python ----------
# -*- coding: utf-8 -*-
import os, sys
base_dir = os.path.dirname(ghdoc.Path)
main_line_dir = "{}//{}//{}".format(base_dir, folder_name,main_line)
# ---------- end python ----------

preview = CustomPreview(Geometry=geometry, Material=ColourSwatch(SwatchColor=RGBA(117, 33, 33, 34)))

panel = Panel("""19
pm04

この２つにエラーあり""")
bbox_2 = BoundingBox(Content=geometry_2, Plane=PlaneXY(0, 0, 0))  # -> Box, Box_2

# ----
# Color Format
# Input
data = Data(1)
# Method
data_2 = Data(1)
# Output
data_3 = Data(1)
# Display
data_4 = Data(1)
# Unuse
data_5 = Data(1)

preview_2 = CustomPreview(Geometry=bbox_2.Box, Material=ColourSwatch(SwatchColor=RGBA(117, 33, 33, 34)))

gettopsurface = GetTopSurfaceFromBox(B=bbox_2.Box)
gettopsurface_2 = GetTopSurfaceFromBox(B=bbox.Box)
createdictionaryfromcsv = CreateDictionaryFromCSV(path=python.main_line_dir)  # -> out, dict
# ---------- createdictionaryfromcsv: Python ----------
__author__ = "ykish"
__version__ = "2023.11.28"


from utils.utils import dictionary_from_csv
dict = dictionary_from_csv(_path)

print(dict)
# ---------- end createdictionaryfromcsv ----------
item = ListItem(List=createdictionaryfromcsv.dict, Index=0, Wrap=True)  # -> Item, Item1, Item2, Item3, Item4, Item5, Item6, Item7, Item8, Item9
getlongercurvesfromsurface = GetLongerCurvesFromRectangularSurface(B=gettopsurface_2)
checkrebardictionay = CheckRebarDictionay(rebar_dict=createdictionaryfromcsv.dict)  # -> out, name, face, z_offset, x_offset, y_offset
# ---------- checkrebardictionay: Python ----------
__author__ = "ykish"
__version__ = "2023.11.28"

_dict = _rebar_dict
name = _dict['name']
face = _dict['face']
z = _dict['z_offset']
x_offset = _dict['x_offset']
y_offset = _dict['y_offset']
# ---------- end checkrebardictionay ----------
sortcurvesfromsurface = SortCurvesFromSurface(A=getlongercurvesfromsurface, G=gettopsurface)  # -> data_6, data_8, data_5, data_7
panel_2 = Panel(checkrebardictionay.name)
panel_3 = Panel(item.Item1)

preview_3 = CustomPreview(Geometry=sortcurvesfromsurface.data_6, Material=ColourSwatch(SwatchColor=RGBA(80, 179, 204, 189)))

createfacedictonary = CreateFaceDictonaryFromCurve(
    C=sortcurvesfromsurface.data_6,
    C_2=sortcurvesfromsurface.data_8,
    C_3=sortcurvesfromsurface.data_5,
    C_4=sortcurvesfromsurface.data_7)
createrebar = CreateRebar(host=graphical_element, face_dict_list=createfacedictonary, rebar_dict_list=item.Item9, bake=create_rebar)  # -> out, planes, curves, elementIds; inputs face_dict_list: list, rebar_dict_list: list, bake: Boolean
# ---------- createrebar: Python ----------
__author__ = "ykish"
__version__ = "2023.11.30"
from utils.revit_utils import get_active_doc
from geometry.geometry import create_plane_list_from_dict_list
from rebar.rebar import create_rebarShape_rhinoCurves_from_dict_list,create_rebarShape_rhinoCurve_from_dict,convert_rhino_to_revit_geometry,get_rebar_type_by_diameter,get_rebar_shape_by_name,get_hook_type_from_shapename,get_hook_orientation_from_shapename,set_rebar_spacing_from_dict
import ghpythonlib.treehelpers as th
from Autodesk.Revit.DB import FilteredElementCollector, BuiltInCategory,Transaction, BuiltInParameter, IFailuresPreprocessor, FailureProcessingResult, BuiltInFailures, ElementId
from Autodesk.Revit.DB.Structure import Rebar, RebarBarType, RebarShape, RebarHookType,RebarReinforcementData, RebarCoupler,RebarCouplerError,RebarHookOrientation
class MyPreProcessor(IFailuresPreprocessor):
    def PreprocessFailures(self, failuresAccessor):
        transactionName = failuresAccessor.GetTransactionName()
        failMessages = failuresAccessor.GetFailureMessages()
        
        if failMessages.Count == 0:
            return FailureProcessingResult.Continue

        for currentMessage in failMessages:
            failID = currentMessage.GetFailureDefinitionId()
            if failID == BuiltInFailures.OverlapFailures.DuplicateRebar:
                failuresAccessor.DeleteWarning(currentMessage)
        
        return FailureProcessingResult.Continue
planes = create_plane_list_from_dict_list(_rebar_dict_list, _face_dict_list)
curves = create_rebarShape_rhinoCurves_from_dict_list(_rebar_dict_list, planes)

def create_rebar_from_dict_CAS(dict,  plane, host):
    doc = get_active_doc()

    shape = create_rebarShape_rhinoCurve_from_dict(dict, plane)
    curves = shape.curve
    norm = shape.plane.Normal
    rv_norm = convert_rhino_to_revit_geometry(norm)
    rv_curves = [convert_rhino_to_revit_geometry(curve) for curve in curves]
    rv_shape = get_rebar_shape_by_name(shape.rv_name)
    rv_type = get_rebar_type_by_diameter(float(dict['diameter']))
    rv_startHookOrientation = get_hook_orientation_from_shapename(shape.rv_name)[0]
    rv_endHookOrientation = get_hook_orientation_from_shapename(shape.rv_name)[1]
    rv_startHookType = get_hook_type_from_shapename(shape.rv_name)[0]
    rv_endHookType = get_hook_type_from_shapename(shape.rv_name)[1]
    print(rv_endHookType.get_Parameter(BuiltInParameter.ALL_MODEL_TYPE_NAME).AsString())
    rebar = Rebar.CreateFromCurvesAndShape(doc, rv_shape, rv_type, rv_startHookType, rv_endHookType, host, rv_norm, rv_curves, rv_startHookOrientation, rv_endHookOrientation)
    return rebar
def create_rebars_from_dict_CAS(dict_list, plane_list, host):
    doc = get_active_doc()
    rebars = []
    with Transaction(doc, 'create_bars') as t:
        t.Start()
        failureOptions = t.GetFailureHandlingOptions()
        handler = MyPreProcessor()
        for i, dict in enumerate(dict_list):
            rebar = create_rebar_from_dict_CAS(dict,  plane_list[i], host)
            rebar = set_rebar_spacing_from_dict(rebar, dict)
            rebars.append(rebar.Id)
        t.SetFailureHandlingOptions(failureOptions)
        t.Commit()

    return rebars


elementIds = create_rebars_from_dict_CAS(_rebar_dict_list, planes, _host)
# ---------- end createrebar ----------
createrebar_2 = CreateRebar(
    host=graphical_element,
    face_dict_list=createfacedictonary,
    rebar_dict_list=createdictionaryfromcsv.dict,
    bake=create_rebar)  # -> out, planes, curves, elementIds; inputs face_dict_list: list, rebar_dict_list: list, bake: Boolean
# ---------- createrebar_2: Python ----------
__author__ = "ykish"
__version__ = "2023.11.30"

from geometry.geometry import create_plane_list_from_dict_list
from rebar.rebar import create_rebars_from_dict_CAS,create_rebarShape_rhinoCurves_from_dict_list
import ghpythonlib.treehelpers as th


planes = create_plane_list_from_dict_list(_rebar_dict_list, _face_dict_list)
curves = create_rebarShape_rhinoCurves_from_dict_list(_rebar_dict_list, planes)
elementIds = create_rebars_from_dict_CAS(_rebar_dict_list, planes, _host)
if _bake:
    elementIds = create_rebars_from_dict_CAS(_rebar_dict_list, planes, _host)
# ---------- end createrebar_2 ----------
panel_4 = Panel(createrebar_2.curves)
panel_5 = Panel(createrebar_2.planes)
panel_6 = Panel(createrebar_2.elementIds)

# ==== cluster GetTopSurfaceFromBox: Extract top surface from box
B = ClusterInput()

debrep = DeconstructBrep(Brep=B)  # -> Faces, Edges, Vertices
evalsrf = EvaluateSurface(Surface=debrep.Faces, Point="{0.5,0.5,0.5}")  # -> Point, Normal, UDirection, VDirection, Frame

Z = UnitZ(Factor=1)
dprod = DotProduct(VectorA=evalsrf.Normal, VectorB=Z, Unitize=False)
equals = Equality(FirstNumber=dprod, SecondNumber="1")  # -> Equality, Inequality
dispatch = Dispatch(List=debrep.Faces, DispatchPattern=equals.Equality)  # -> ListA, ListB

geo = Geometry(dispatch.ListA)
geo_2 = ClusterOutput(geo)

# ==== cluster GetLongerCurvesFromRectangularSurface: Get Longer Curves From Rectangular Surface
B = ClusterInput()
edges = BrepEdges(Brep=B)  # -> Naked, Interior, NonManifold

len = Length(Curve=edges.Naked)
sort = SortList(Keys=len, ValuesA=edges.Naked)  # -> Keys, reverse(ValuesA)
item = ListItem(List=sort.ValuesA, Index=0, Wrap=True)  # -> Item, Item1
crv = Curve([item.Item, item.Item1])

crv_2 = ClusterOutput(crv)

# ==== cluster SortCurvesFromSurface: Sort Curves by Distance from surface
A = ClusterInput()
G = ClusterInput()

project = Project(Geometry=A, Plane=G)  # -> Geometry, Transform
midpt = CurveMiddle(Curve=project.Geometry)
pull = PullPoint(Point=midpt, Geometry=G, ClosestOnly=True)  # -> ClosestPoint, Distance

sort = SortList(Keys=pull.Distance, ValuesA=A)  # -> Keys, ValuesA
item = ListItem(List=sort.ValuesA, Index=0, Wrap=True)  # -> Item1, Item
end = EndPoints(Curve=item.Item)  # -> Start, End
end_2 = EndPoints(Curve=item.Item1)  # -> Start, End
ln = Line(StartPoint=end.End, EndPoint=end_2.Start)
ln_2 = Line(StartPoint=end_2.End, EndPoint=end.Start)
data = Data(ln)
data_2 = Data(item.Item1)
data_3 = Data(ln_2)
data_4 = Data(item.Item)
data_5 = ClusterOutput(data)
data_6 = ClusterOutput(data_2)
data_7 = ClusterOutput(data_3)
data_8 = ClusterOutput(data_4)
panel = Panel(sort.Keys)

# ==== cluster CreateFaceDictonaryFromCurve: Create Face Dictonary From Curve
C = ClusterInput()
C_2 = ClusterInput()
C_3 = ClusterInput()
C_4 = ClusterInput()
getvectorsfromcurve = GetVectorsFromCurve(C=C)  # -> pt_2, x_2, y_3, z_3
getvectorsfromcurve_2 = GetVectorsFromCurve(C=C_2)  # -> pt_2, x_2, y_3, z_3
getvectorsfromcurve_3 = GetVectorsFromCurve(C=C_3)  # -> pt_2, x_2, y_3, z_3
getvectorsfromcurve_4 = GetVectorsFromCurve(C=C_4)  # -> pt_2, x_2, y_3, z_3
python = GhPythonScript(index=1, Pt=getvectorsfromcurve.pt_2, x=getvectorsfromcurve.x_2, y=getvectorsfromcurve.y_3, z=getvectorsfromcurve.z_3)  # -> out, a; inputs Pt: Point3d, x: Vector3d, y: Vector3d, z: Vector3d
# ---------- python: Python ----------
__author__ = "ykish"
__version__ = "2023.11.30"

import rhinoscriptsyntax as rs

a= [{"i":index, "Pt":Pt, "x":x,"y":y,"z":z}]
# ---------- end python ----------
python_2 = GhPythonScript(
    index=2,
    Pt=getvectorsfromcurve_2.pt_2,
    x=getvectorsfromcurve_2.x_2,
    y=getvectorsfromcurve_2.y_3,
    z=getvectorsfromcurve_2.z_3)  # -> out, a; inputs Pt: Point3d, x: Vector3d, y: Vector3d, z: Vector3d; same code as python
python_3 = GhPythonScript(
    index=3,
    Pt=getvectorsfromcurve_3.pt_2,
    x=getvectorsfromcurve_3.x_2,
    y=getvectorsfromcurve_3.y_3,
    z=getvectorsfromcurve_3.z_3)  # -> out, a; inputs Pt: Point3d, x: Vector3d, y: Vector3d, z: Vector3d; same code as python
python_4 = GhPythonScript(
    index=4,
    Pt=getvectorsfromcurve_4.pt_2,
    x=getvectorsfromcurve_4.x_2,
    y=getvectorsfromcurve_4.y_3,
    z=getvectorsfromcurve_4.z_3)  # -> out, a; inputs Pt: Point3d, x: Vector3d, y: Vector3d, z: Vector3d; same code as python
merge = Merge(Data1=python.a, Data2=python_2.a, Data3=python_3.a, Data4=python_4.a)
R = ClusterOutput(merge)

# ==== cluster GetVectorsFromCurve: Get X , Y and Z Vectors From Base Curve.
C = ClusterInput()
end = EndPoints(Curve=C)  # -> Start, End
Z = UnitZ(Factor=1)
neg = Negative(Value=Z)
vec2pt = Vector2Pt(PointA=end.Start, PointB=end.End, Unitize=True)  # -> Vector, Length
z = Vector(neg)
y = Vector(vec2pt.Vector)
xprod = CrossProduct(VectorA=y, VectorB=z, Unitize=False)  # -> Vector, Length
merge = Merge(Data1=flatten(y), Data2=flatten(xprod.Vector), Data3=flatten(z))
v = Vector(merge)
item = ListItem(List=v, Index=0, Wrap=True)  # -> Item, Item1, Item2
x = Vector(item.Item)
pt = Point(end.Start)
z_2 = Vector(item.Item2)
y_2 = Vector(item.Item1)
pt_2 = ClusterOutput(pt)
x_2 = ClusterOutput(x)
y_3 = ClusterOutput(y_2)
z_3 = ClusterOutput(z_2)
