# Grasshopper definition 20231130_test_readcsv.gh (Grasshopper 1.0.7)
# plug-ins: Bifocals, Rhino.Inside for Autodesk Revit

graphical_element = GraphicalElement(<wall referenced from the Revit model>)
graphical_element_2 = GraphicalElement(<wall referenced from the Revit model>)

# ---- group: main
path = FilePath("G:\Shared drives\Development\100_Projects\0011_SZ_RibarTools\08_InternalWorkFolder\Wall2\20231130\data\ProgramInput_D-wall_Mainbar.csv")

# ---- group: shearlink
shearlink = FilePath("G:\Shared drives\Development\100_Projects\0011_SZ_RibarTools\08_InternalWorkFolder\Wall2\20231130\data\ProgramInput_D-wall_Shearlinks.csv")

# ----
path_2 = FilePath("G:\Shared drives\Development\100_Projects\0011_SZ_RibarTools\08_InternalWorkFolder\Wall2\20231130\data\ProgramInput_D-wall_Starterbar.csv")

# ---- group: dist
path_3 = FilePath("G:\Shared drives\Development\100_Projects\0011_SZ_RibarTools\08_InternalWorkFolder\Wall2\20231130\data\ProgramInput_D-wall_Distbar.csv")

# ---- group: Stiffner
shearlink_2 = FilePath("G:\Shared drives\Development\100_Projects\0011_SZ_RibarTools\08_InternalWorkFolder\Wall2\20231130\data\ProgramInput_D-wall_Stiffener.csv")

# ----
gallery = ImageGallery(CycleDelay=30, Randomize=False, UseLocalImages=True, UseRemoteImages=True)
path_4 = FilePath("G:\Shared drives\Development\100_Projects\0011_SZ_RibarTools\08_InternalWorkFolder\Wall2\New folder\ProgramInput_D-wall_Mainbar.csv")
panel = Panel(shearlink)

# ---- group: RebarToolkit Uninstaller
rtuninstall = RebarToolkitInstaller()  # -> out, message; inputs uninstall: Boolean
# ---------- rtuninstall: Python ----------
__author__ = "ykish"
__version__ = "2023.11.28"

ghenv.Component.Name = 'RebarToolkit Installer'
ghenv.Component.NickName = 'RTUninstall'

ghenv.Component.Category = 'RebarToolkit'

import clr
import os
import shutil
clr.AddReference("System")
from System import Array
import Rhino

def remove_directory(path):
    """ Remove a directory and all its contents """
    if os.path.exists(path):
        shutil.rmtree(path)
        message = "Removed directory: {}".format(path)
    else:
        message = "Directory not found: {}".format(path)
    return message

def remove_from_python_search_paths(path):
    """ Remove a path from Rhino's Python script search paths """
    current_paths = list(Rhino.Runtime.PythonScript.SearchPaths)
    if path in current_paths:
        current_paths.remove(path)
        Rhino.Runtime.PythonScript.SearchPaths = Array[str](current_paths)
        message = "Removed from Python search paths: {}".format(path)
    else:
        message = "Path not found in Python search paths: {}".format(path)
    return message


if _uninstall:
    message =[]
    print("start uninstall")
    save_dir = os.path.join(os.environ["LOCALAPPDATA"], "GEL", "RebarToolkit")
    message.append(remove_directory(save_dir))
    package_dir= os.path.join(save_dir,'my_package')
    message.append(remove_from_python_search_paths(package_dir))
# ---------- end rtuninstall ----------

# ----
python = GhPythonScript(path=path_4)  # -> out, a
# ---------- python: Python ----------
__author__ = "ykish"
__version__ = "2023.11.28"
import os
import rhinoscriptsyntax as rs
import csv
from rebar.rebarShape import RebarShapeCurve
def dictionary_from_csv(csv_path):
    """Read a CSV file and return a list of dictionaries of its contents."""
    with open(csv_path, 'r') as csv_file:
        # csv.DictReaderを使用してCSVファイルを読み込む
        dict_list = [row for row in csv.DictReader(csv_file)]
    return dict_list

csv_path = os.path.abspath(_path)
print(csv_path)
dict_list = dictionary_from_csv(csv_path)
print(dict_list)

shapes = [item['shape'] for item in dict_list]
print(shapes)

params_template = {'a': None, 'b': None, 'c': None, 'd': None, 'e': None, 'f': None, 'g': None, 'h': None, 'x': None, 'y': None, 'j': None}

updated_params_list = []
for d in dict_list:
    updated_params = params_template.copy()
    for key in updated_params:
        if key in d:
            if d[key] =="":
                updated_params[key] = None
            else:
                updated_params[key] = d[key]
    updated_params_list.append(updated_params)
def update_params_from_dict_list(dict_list, params_template):

    updated_params_list = []
    for d in dict_list:
        updated_params = params_template.copy()
        for key in updated_params:
            if key in d:
                updated_params[key] = None if d[key] == "" else d[key]
        updated_params_list.append(updated_params)
    
    return updated_params_list
    
def create_rebarShapeParams_from_csv(csv_path):
    dict_list = dictionary_from_csv(csv_path)
    params_template = {'a': None, 'b': None, 'c': None, 'd': None, 'e': None, 'f': None, 'g': None, 'h': None, 'x': None, 'y': None, 'j': None}
    updated_params_list = update_params_from_dict_list(dict_list, params_template)
    return updated_params_list

def create_rebarShape_from_csv(csv_path):
    params_list = create_rebarShapeParams_from_csv(csv_path)
    print(params_list[0])
    dict_list = dictionary_from_csv(csv_path)
    name_list = [d['name'] for d in dict_list]
    rebarShape_list = []
    for dict, i in enumerate(dict_list):
        rgType = "rg01"
        rebarShape_list.append(RebarShapeCurve(rgType, plane=None,**params_list[i]))
    return rebarShape_list
    
    

create_rebarShape_from_csv(csv_path)
# ---------- end python ----------
python_2 = GhPythonScript(path=panel)  # -> out, dict
# ---------- python_2: Python ----------
__author__ = "ykish"
__version__ = "2023.11.28"


from utils.utils import dictionary_from_csv
dict = dictionary_from_csv(_path)
# ---------- end python_2 ----------
bbox = BoundingBox(Content=graphical_element_2, Plane=PlaneXY(0, 0, 0))  # -> Box, Box_2
lng = ListLength(List=python_2.dict)
item = ListItem(List=python_2.dict, Index=Slider(8, range=0..100), Wrap=True)
debrep = DeconstructBrep(Brep=bbox.Box_2)  # -> Faces, Edges, Vertices
python_3 = GhPythonScript(dict=python_2.dict)  # -> out, curve
# ---------- python_3: Python ----------
__author__ = "ykish"
__version__ = "2023.11.28"


from rebar.rebar import create_rebarShape_rhinoCurve_from_dict
from rebar.data_processor import find_row_by_name
from rebar.rebarShape import RebarShapeCurve

def create_rebarShapePrarams_from_dict(dict):
    params_template = {'a': None, 'b': None, 'c': None, 'd': None, 'e': None, 'f': None, 'g': None, 'h': None, 'x': None, 'y': None, 'j': None}
    updated_params = params_template.copy()
    for key in updated_params:
        if key in dict:
            updated_params[key] = None if dict[key] == "" else float(dict[key])
    return updated_params
            
shapeName = _dict['shape']
shapeName = "00" if shapeName =='0' else _dict['shape']
data= find_row_by_name(shapeName)
print(data)
rgName = data[0]['RhinoBaseLineType']
params = create_rebarShapePrarams_from_dict(_dict)
curve = RebarShapeCurve(rgName,shapeName, _plane,**params).curve
print(params)
# ---------- end python_3 ----------
series = Series(Start=0, Step=Slider(3000, range=0..10000), Count=lng)
python_4 = GhPythonScript(dict=item)  # -> out, curve
# ---------- python_4: Python ----------
__author__ = "ykish"
__version__ = "2023.11.28"


from rebar.rebar import create_rebarShape_rhinoCurve_from_dict

curve = create_rebarShape_rhinoCurve_from_dict(_dict,_plane).curve
# ---------- end python_4 ----------
item_2 = ListItem(List=debrep.Vertices, Index=0, Wrap=True)
python_5 = GhPythonScript(dict=python_2.dict)  # -> out, name, face, z, x_offset, y_offset, shape
# ---------- python_5: Python ----------
__author__ = "ykish"
__version__ = "2023.11.28"


name = _dict['name']
face = _dict['face']
z = _dict['z_offset']
x_offset = _dict['x_offset']
y_offset = _dict['y_offset']
shape = _dict['shape']

print(_dict)
# ---------- end python_5 ----------
toggle = BooleanToggle(False)
Z = UnitZ(Factor=1)
Z_2 = UnitZ(Factor=series)

# ----
# Color Format
# Input
data = Data(1)
# Method
data_2 = Data(1)
# Output
data_3 = Data(1)
# Display
data_4 = Data(1)
# Unuse
data_5 = Data(1)

crv = Curve(python_4.curve)
move = Move(Geometry=item_2, Motion=Z_2)  # -> Geometry, Transform
panel_2 = Panel(python_5.shape)
pl = PlaneNormal(Origin=move.Geometry, ZAxis=Vector(0, 0, 1))
python_6 = GhPythonScript(host=graphical_element_2, plane_list=pl, dict_list=python_2.dict, bake=toggle)  # -> out, a; inputs plane_list: list of Plane, dict_list: list, bake: Boolean
# ---------- python_6: Python ----------
__author__ = "ykish"
__version__ = "2023.11.30"

from utils.rhinoinside_utils import convert_rhino_to_revit_geometry
from utils.revit_utils import get_active_doc, get_active_ui_doc
from rebar.rebar import set_rebar_spacing_from_dict,create_rebarShape_rhinoCurve_from_dict,get_rebar_shape_by_name,get_rebar_type_by_diameter,get_hook_type_from_shapename,get_hook_orientation_from_shapename
from Autodesk.Revit.DB import FilteredElementCollector, BuiltInCategory,Transaction, BuiltInParameter, IFailuresPreprocessor, FailureProcessingResult, BuiltInFailures, ElementId
from Autodesk.Revit.DB.Structure import Rebar, RebarBarType, RebarShape, RebarHookType,RebarReinforcementData, RebarCoupler,RebarCouplerError,RebarHookOrientation
class MyPreProcessor(IFailuresPreprocessor):
    def PreprocessFailures(self, failuresAccessor):
        transactionName = failuresAccessor.GetTransactionName()
        failMessages = failuresAccessor.GetFailureMessages()
        
        if failMessages.Count == 0:
            return FailureProcessingResult.Continue

        for currentMessage in failMessages:
            failID = currentMessage.GetFailureDefinitionId()
            if failID == BuiltInFailures.OverlapFailures.DuplicateRebar:
                failuresAccessor.DeleteWarning(currentMessage)
def create_rebar_from_dict_CAS(dict,  plane, host):
    doc = get_active_doc()

    shape = create_rebarShape_rhinoCurve_from_dict(dict, plane)
    curves = shape.curve
    norm = shape.plane.Normal
    rv_norm = convert_rhino_to_revit_geometry(norm)
    rv_curves = [convert_rhino_to_revit_geometry(curve) for curve in curves]
    rv_shape = get_rebar_shape_by_name(shape.rv_name)
    rv_type = get_rebar_type_by_diameter(float(dict['diameter']))
    rv_startHookOrientation = get_hook_orientation_from_shapename(shape.rv_name)[0]
    rv_endHookOrientation = get_hook_orientation_from_shapename(shape.rv_name)[1]
    rv_startHookType = get_hook_type_from_shapename(shape.rv_name)[0]
    rv_endHookType = get_hook_type_from_shapename(shape.rv_name)[1]
    print(rv_shape.get_Parameter(BuiltInParameter.ALL_MODEL_TYPE_NAME).AsString())
    print(rv_startHookOrientation)
    print(rv_endHookOrientation)
    print(rv_startHookType.get_Parameter(BuiltInParameter.ALL_MODEL_TYPE_NAME).AsString())
    print(rv_endHookType.get_Parameter(BuiltInParameter.ALL_MODEL_TYPE_NAME).AsString())
    #rebar = Rebar.CreateFromCurvesAndShape(doc, rv_shape, rv_type, rv_startHookType, rv_endHookType, host, rv_norm, rv_curves, rv_startHookOrientation, rv_endHookOrientation)
    rebar = Rebar.CreateFromCurvesAndShape(doc, rv_shape, rv_type, None, None, host, rv_norm, rv_curves, rv_startHookOrientation, rv_endHookOrientation)
    return rebar
def create_rebars_from_dict_CAS(dict_list, plane_list, host):
    doc = get_active_doc()
    rebars = []
    with Transaction(doc, 'create_bars') as t:
        t.Start()
        failureOptions = t.GetFailureHandlingOptions()
        handler = MyPreProcessor()
        for i, dict in enumerate(dict_list):
            rebar = create_rebar_from_dict_CAS(dict,  plane_list[i], host)
            rebar = set_rebar_spacing_from_dict(rebar, dict)
            rebars.append(rebar.Id)
        t.SetFailureHandlingOptions(failureOptions)
        t.Commit()

    return rebars

a = create_rebars_from_dict_CAS(_dict_list, _plane_list, _host)
# ---------- end python_6 ----------
pln = Plane(pl)
python_7 = GhPythonScript(host=graphical_element_2, normal_list=Z, plane_list=pln, dict_list=python_2.dict, bake=Toggle(False))  # -> out, planes, curves, elementId; inputs normal_list: list of Vector3d, plane_list: list of Plane, dict_list: list, bake: Boolean
# ---------- python_7: Python ----------
__author__ = "ykish"
__version__ = "2023.11.30"
from rebar.rebar import create_rebars_from_dict_CAS,set_rebar_spacing_from_dict,create_rebarShape_rhinoCurves_from_dict_list
from geometry.geometry import create_plane_list_from_dict_list
planes = create_plane_list_from_dict_list(_rebar_dict, _face_dict)
curves = create_rebarShape_rhinoCurves_from_dict_list(_rebar_dict,_plane_list)
if _bake:
    elementId= create_rebars_from_dict_CAS(_rebar_dict, _plane_list, _host)
# ---------- end python_7 ----------
panel_3 = Panel(python_7.curves)
python_8 = GhPythonScript(host=graphical_element_2, face_list=pln, dict_list=python_2.dict, bake=toggle)  # -> out, planes, curves, elementId; inputs face_list: list of Plane, dict_list: list, bake: Boolean
# ---------- python_8: Python ----------
__author__ = "ykish"
__version__ = "2023.11.30"
import Rhino.Geometry as rg

import Rhino.Geometry as rg
from rebar.rebar import create_rebarShape_rhinoCurves_from_dict_list
def create_plane_from_dict(d, plane, normal):
    """Create a Rhino.Geometry.Plane object from a dictionary."""
    x = float(d["x_offset"])
    y= float(d["y_offset"])
    z = float(d["z"])
    origin = plane.Origin
    xaxis = plane.XAxis
    yaxis = plane.YAxis
    zaxis = plane.ZAxis
    place_origin =origin + xaxis * x + yaxis * y + zaxis * z

    new_plane = rg.Plane(place_origin, normal)
    return new_plane

def create_plane_list_from_dict_list(dict_list, plane_list, normal_list):
    """Create a list of Rhino.Geometry.Plane objects from a list of dictionaries."""
    result_planes  = []
    len_planes = len(plane_list)
    len_normals = len(normal_list)
    print(len_planes,len_normals)
    for i, d in enumerate(dict_list):
        plane = plane_list[min(i, len_planes - 1)]
        normal = normal_list[min(i, len_normals - 1)]
        new_plane = create_plane_from_dict(d, plane, normal)
        result_planes .append(new_plane)
    return result_planes 

#planes = create_plane_list_from_dict_list(_dict_list, _plane_list, _normal_list)
curves_list = create_rebarShape_rhinoCurves_from_dict_list(_dict_list,_plane_list)
curves = []
for c in curves_list:
    curves.append(c.curve)
    
elementId =
# ---------- end python_8 ----------
panel_4 = Panel(python_5.z)
panel_5 = Panel(crv)
pln_2 = Plane(python_8.planes)
crv_2 = Curve(python_8.curves)
python_9 = GhPythonScript(host=graphical_element_2, plane_list=pl, dict_list=python_2.dict, bake=toggle)  # -> out, a; inputs plane_list: list of Plane, dict_list: list, bake: Boolean
# ---------- python_9: Python ----------
__author__ = "ykish"
__version__ = "2023.11.30"


from utils.revit_utils import get_active_doc, get_active_ui_doc
from rebar.rebar import create_rebar_from_dict_CAS,set_rebar_spacing_from_dict
from Autodesk.Revit.DB import FilteredElementCollector, BuiltInCategory,Transaction, BuiltInParameter, IFailuresPreprocessor, FailureProcessingResult, BuiltInFailures, ElementId
from Autodesk.Revit.DB.Structure import Rebar, RebarBarType, RebarShape, RebarHookType,RebarReinforcementData, RebarCoupler,RebarCouplerError,RebarHookOrientation
class MyPreProcessor(IFailuresPreprocessor):
    def PreprocessFailures(self, failuresAccessor):
        transactionName = failuresAccessor.GetTransactionName()
        failMessages = failuresAccessor.GetFailureMessages()
        
        if failMessages.Count == 0:
            return FailureProcessingResult.Continue

        for currentMessage in failMessages:
            failID = currentMessage.GetFailureDefinitionId()
            if failID == BuiltInFailures.OverlapFailures.DuplicateRebar:
                failuresAccessor.DeleteWarning(currentMessage)
        
def create_rebars_from_dict_CAS(dict_list, plane_list, host):
    doc = get_active_doc()
    rebars = []
    with Transaction(doc, 'create_bars') as t:
        t.Start()
        failureOptions = t.GetFailureHandlingOptions()
        handler = MyPreProcessor()
        for i, dict in enumerate(dict_list):
            rebar = create_rebar_from_dict_CAS(dict,  plane_list[i], host)
            rebar = set_rebar_spacing_from_dict(rebar, dict)
            rebars.append(rebar.Id)
        t.SetFailureHandlingOptions(failureOptions)
        t.Commit()

    return rebars

a = create_rebars_from_dict_CAS(_dict_list, _plane_list, _host)
# ---------- end python_9 ----------
geo = Geometry(python_8.curves)
panel_6 = Panel(python_2.dict)
python_10 = GhPythonScript(dict=python_2.dict)  # -> out, name, face, z, x_offset, y_offset
# ---------- python_10: Python ----------
__author__ = "ykish"
__version__ = "2023.11.28"


name = _dict['name']
face = _dict['face']
z = _dict['z']
x_offset = _dict['x_offset']
y_offset = _dict['y_offset']
# ---------- end python_10 ----------
crv_3 = Curve()
python_11 = GhPythonScript()  # -> out, a
# ---------- python_11: Python ----------
__author__ = "ykish"
__version__ = "2023.11.29"

import clr
clr.AddReference('RhinoInside.Revit')
clr.AddReference('System.Core')
clr.AddReference('RevitAPI') 
clr.AddReference('RevitAPIUI')
from RhinoInside.Revit import Revit, Convert
from Autodesk.Revit.DB import XYZ, Line as RevitLine, CurveArray, CurveArrArray,NurbSpline,BoundingBoxXYZ, Arc as RevitArc,Curve as RevitCurve,CurveLoop,CylindricalHelix, Ellipse as RevitEllipse,HermiteSpline 
from Rhino.Geometry import Arc, Circle,Point3d,Point3f, Vector3d,Vector3f,Line ,Polyline, PolyCurve, Curve, PolylineCurve, NurbsCurve,LineCurve,Ellipse,Arc,Circle,ArcCurve
# ---------- end python_11 ----------
circle = Circle()
