# Grasshopper definition 20231204_test_rebarShapeCurve.gh (Grasshopper 1.0.7)
# plug-ins: Bifocals, ShapeDiverForGrasshopper

e = Slider(417, range=0..1000)
number_slider = Slider(95, range=0..100)
b = Slider(442, range=0..1000)
c = Slider(353, range=0..1000)
d = Slider(270, range=0..1000)
f = Slider(250, range=0..1000)
g = Slider(200, range=0..1000)
h = Slider(196, range=0..1000)
xy = XYPlane(Origin=Point(0, 0, 0))
sddp = ShapeDiverDocumentPayload({AbsoluteTolerance=0, AngleTolerance=0, DistanceDisplayPrecision=0, GltfVersion="Gltf2", InputGroups="{}", OutputGroups="{}", RelativeTolerance=0, UnitSystem=0, VersionCreated="1.13.1.0", VersionSaved="1.13.1.0"})
gallery = ImageGallery(CycleDelay=30, Randomize=False, UseLocalImages=True, UseRemoteImages=True)
list = ValueList({"00", "pm01", "pm02", "pm03", "02", "19", "20", "pm04", "06"}, selected="pm02")
path = FilePath("C:\Users\ykish\Documents\GitHub\RebarRIRToolkit\my_package\rebar\rebarShape.py")
path_2 = FilePath("C:\Users\ykish\Documents\GitHub\RebarRIRToolkit\gh_scripts\gh_test_rebarShapeCurve.py")
file = ReadFile(File=path, PerLineParse=False)
file_2 = ReadFile(File=path_2, PerLineParse=False)
python = GhPythonScript(Code=file)  # -> Out, A
neg = Negative(Value=g)
neg_2 = Negative(Value=f)
python_2 = GhPythonScript(
    Code=file_2,
    _length_parameters="a,b,c,d,e,x",
    _rgLineType="rg18",
    P=xy,
    A=Slider(289, range=0..1000),
    B=b,
    C=c,
    D=d,
    E=e,
    F=neg_2,
    G=neg,
    H=h,
    X=Slider(100, range=0..100),
    Y=number_slider,
    J=number_slider,
    Run=Button())  # -> Out, Curve, HookAtStart, HookAtEnd, HookOrientationStart, HookOrientationEnd

# ----
# Color Format
# Input
data = Data(1)
# Method
data_2 = Data(1)
# Output
data_3 = Data(1)
# Display
data_4 = Data(1)
# Unuse
data_5 = Data(1)

preview = CustomPreview(Geometry=python_2.Curve, Material=ColourSwatch(SwatchColor=RGB(250, 0, 0)))
