# Grasshopper definition 20240205_Standarization_GetRebarBrowserCurves.gh (Grasshopper 1.0.7)
# plug-ins: Bifocals, Rhino.Inside for Autodesk Revit

gallery = ImageGallery(CycleDelay=30, Randomize=False, UseLocalImages=True, UseRemoteImages=True)
panel = Panel("rg01")
panel_2 = Panel("rg02")

# ----
# Dowonload Python Code From Github
button = Button()
python = GhPythonScript(b=button)  # -> out, a
# ---------- python: Python ----------
__author__ = "ykish"
__version__ = "2023.10.02"

import System
import urllib
import zipfile
import os

def download_github_repo_as_zip(repo_url):
    # GitHubのリポジトリURLからZIPファイルのURLを生成
    zip_url = repo_url.rstrip('/') + '/archive/refs/heads/main.zip'
    
    # ZIPファイルをダウンロード
    response = urllib.urlopen(zip_url)
    data = response.read()
    
    # 指定の場所にZIPファイルを保存 C:\Users\[ユーザー名]\AppData\Local\GEL\RebarTool
    appdata_local = System.Environment.GetFolderPath(System.Environment.SpecialFolder.LocalApplicationData)
    gel_rebartool_directory = os.path.join(appdata_local, 'GEL', 'RebarTool')
    if not os.path.exists(gel_rebartool_directory):
        os.makedirs(gel_rebartool_directory)
    filename = "repository.zip"
    save_path = os.path.join(gel_rebartool_directory, filename)
    with open(save_path, 'wb') as file:
        file.write(data)
    return save_path, gel_rebartool_directory;

def unzip_file(zip_filepath, dest_dir):
    """
    ZIPファイルを解凍する関数

    Parameters:
    - zip_filepath: 解凍するZIPファイルのパス
    - dest_dir: 解凍したファイルを保存するディレクトリのパス
    """
    with zipfile.ZipFile(zip_filepath, 'r') as zip_ref:
        zip_ref.extractall(dest_dir)

# 使用例
repo_url = "https://github.com/GEL-Dev/RebarToolRIR" # Python 2ではraw_inputを使用""
save_path,gel_rebartool_directory = download_github_repo_as_zip(repo_url)
unzip_file(save_path,gel_rebartool_directory )
# ---------- end python ----------

panel_3 = Panel("rg03")
panel_4 = Panel("rg04")
# Read Python Code
graphical_element = GraphicalElement(<wall referenced from the Revit model>)
list = ValueList({"00", "01", "02", "03", "04", "05"}, selected="00")
# RebarShapeData
panel_5 = Panel("10")
panel_6 = Panel("rg05")
b = Slider(6405, range=0..10000)
b_2 = Slider(6020, range=0..10000)
b_3 = Slider(2786, range=0..10000)
c = Slider(5596, range=0..10000)
b_4 = Slider(2786, range=0..10000)
geometry = ElementGeometry(Elements=graphical_element)
pln = Plane(Plane(origin=(2013.223012, 4722.446329, 0), x=(-0.7059478659, 0.7082638002, 0), y=(0.7082638002, 0.7059478659, 0)))
python_2 = GhPythonScript(a=Slider(3658, range=0..10000), plane=pln)  # -> out, line; inputs plane: Plane
# ---------- python_2: Python ----------
__author__ = "ykish"
__version__ = "2023.11.20"

import Rhino.Geometry as rg

if a is None:
    a = 1000
if plane is None:
    plane = rg.Plane.WorldXY
    
fromPt = rg.Point3d(0,0,0);
toPt = rg.Point3d(a,0,0);
base_line = rg.Line(fromPt,toPt)

# Move the line to the plane
orient = rg.Transform.PlaneToPlane(rg.Plane.WorldXY,plane)
base_line.Transform(orient)
line = base_line
# ---------- end python_2 ----------
selectrebarshape = SelectRebarShape(shape=panel_5)  # -> out, selectedRebarShape, style
# ---------- selectrebarshape: Python ----------
__author__ = "ykish"
__version__ = "2023.05.08"

import rhinoscriptsyntax as rs

import clr
clr.AddReference('System.Core')
clr.AddReference('RhinoInside.Revit')
clr.AddReference('RevitAPI') 
clr.AddReference('RevitAPIUI')
import math
import Rhino
import RhinoInside
import Grasshopper
import ghpythonlib.treehelpers as th
import Grasshopper.Kernel.Data.GH_Path as GH_Path
import Grasshopper.DataTree as DataTree
import scriptcontext
from RhinoInside.Revit import Revit, Convert
from Autodesk.Revit import DB
from Autodesk.Revit.DB.Structure import *
from System.Collections.Generic import List, IList
from System import Enum, Action

doc = Revit.ActiveDBDocument
if shape is not None:

    allRebarShape  = DB.FilteredElementCollector(doc).OfClass(DB.Structure.RebarShape).WhereElementIsElementType().ToElements()
    selectedRebarShape = [rebarShape for rebarShape in allRebarShape if rebarShape.get_Parameter(DB.BuiltInParameter.ALL_MODEL_TYPE_NAME).AsString() == shape]
    style = [rebarShape.get_Parameter(DB.BuiltInParameter.REBAR_SHAPE_HOOK_STYLE).AsValueString() for rebarShape in selectedRebarShape]
for res in allRebarShape:
    print res.Id
    print doc.GetElement(res.Id).get_Parameter(DB.BuiltInParameter.REBAR_SHAPE_HOOK_STYLE)
# ---------- end selectrebarshape ----------
python_3 = GhPythonScript(a=Slider(4678, range=0..10000), b=b_2)  # -> out, line; inputs plane: Plane
# ---------- python_3: Python ----------
"""Provides a scripting component.
    Inputs:
        a: length of line
        b: length of line
        plane: The base plane
    Output:
        line: The line"""

import Rhino.Geometry as rg


if a is None:
    a = 1000
    
if b is None:
    b = 1000

if plane is None:
    plane = rg.Plane.WorldXY

fromPt = rg.Point3d(0,0,0);
toPt = rg.Point3d(a,0,0);
base_line = rg.Line(fromPt,toPt)

toPt2 = rg.Point3d(a,b,0);
base_line2 = rg.Line(toPt,toPt2)



# Move the line to the plane
orient = rg.Transform.PlaneToPlane(rg.Plane.WorldXY,plane)
base_line.Transform(orient)
base_line2.Transform(orient)
line = [base_line,base_line2]
# ---------- end python_3 ----------
python_4 = GhPythonScript(a=Slider(4341, range=0..10000), b=b_3)  # -> out, line; inputs plane: Plane
# ---------- python_4: Python ----------
"""Provides a scripting component.
    Inputs:
        a: length of line
        b: length of line
        plane: The base plane
    Output:
        line: The line"""

import Rhino.Geometry as rg


if a is None:
    a = 1000
    
if b is None:
    b = 1000

if plane is None:
    plane = rg.Plane.WorldXY

fromPt = rg.Point3d(0,0,0);
toPt1 = rg.Point3d(a,0,0);
base_line = rg.Line(fromPt,toPt1)

toPt2 = rg.Point3d(a,b,0);
base_line2 = rg.Line(toPt1,toPt2)

toPt3 = rg.Point3d(0,b,0);
base_line3 = rg.Line(toPt2,toPt3)



# Move the line to the plane
orient = rg.Transform.PlaneToPlane(rg.Plane.WorldXY,plane)
base_line.Transform(orient)
base_line2.Transform(orient)
base_line3.Transform(orient)
line = [base_line,base_line2, base_line3]
# ---------- end python_4 ----------
python_5 = GhPythonScript(a=Slider(4341, range=0..10000), b=b)  # -> out, line; inputs plane: Plane
# ---------- python_5: Python ----------
"""Provides a scripting component.
    Inputs:
        a: length of line
        b: length of line
        plane: The base plane
    Output:
        line: The line"""

import Rhino.Geometry as rg


if a is None:
    a = 1000
    
if b is None:
    b = 1000

if plane is None:
    plane = rg.Plane.WorldXY

fromPt = rg.Point3d(0,0,0);
toPt = rg.Point3d(b,0,0);
base_line = rg.Line(fromPt,toPt)

toPt2 = rg.Point3d(b,a,0);
base_line2 = rg.Line(toPt,toPt2)



# Move the line to the plane
orient = rg.Transform.PlaneToPlane(rg.Plane.WorldXY,plane)
base_line.Transform(orient)
base_line2.Transform(orient)
line = [base_line,base_line2]
# ---------- end python_5 ----------
python_6 = GhPythonScript(a=Slider(4341, range=0..10000), b=b_4, c=c)  # -> out, line; inputs plane: Plane
# ---------- python_6: Python ----------
"""Provides a scripting component.
    Inputs:
        a: length of line
        b: length of line
        plane: The base plane
    Output:
        line: The line"""

import Rhino.Geometry as rg


if a is None:
    a = 1000
    
if b is None:
    b = 1000

if plane is None:
    plane = rg.Plane.WorldXY

fromPt = rg.Point3d(0,0,0);
toPt1 = rg.Point3d(b,0,0);
base_line = rg.Line(fromPt,toPt1)

toPt2 = rg.Point3d(b,a,0);
base_line2 = rg.Line(toPt1,toPt2)

toPt3 = rg.Point3d(b-c,a,0);
base_line3 = rg.Line(toPt2,toPt3)



# Move the line to the plane
orient = rg.Transform.PlaneToPlane(rg.Plane.WorldXY,plane)
base_line.Transform(orient)
base_line2.Transform(orient)
base_line3.Transform(orient)
line = [base_line,base_line2, base_line3]
# ---------- end python_6 ----------

# ----
# Read Python Code
panel_7 = Panel("sample.py")
python_7 = GhPythonScript(fileName=panel_7)  # -> out, a
# ---------- python_7: Python ----------
__author__ = "ykish"
__version__ = "2023.10.02"

import System
import rhinoscriptsyntax as rs
import os
appdata_local = System.Environment.GetFolderPath(System.Environment.SpecialFolder.LocalApplicationData)
gel_rebartool_directory = os.path.join(appdata_local, 'GEL', 'RebarTool','RebarToolRIR-main', fileName)
a = gel_rebartool_directory
# ---------- end python_7 ----------
file = ReadFile(File=python_7.a, PerLineParse=False)
python_8 = GhPythonScript(Code=file, X=Toggle(True))  # -> Out, A

getrebarshapebyname = GetRebarShapeByName(shape=panel_5)  # -> out, rebarShape
# ---------- getrebarshapebyname: Python ----------
__author__ = "ykish"
__version__ = "2023.05.08"

import rhinoscriptsyntax as rs

import clr
clr.AddReference('System.Core')
clr.AddReference('RhinoInside.Revit')
clr.AddReference('RevitAPI') 
clr.AddReference('RevitAPIUI')
import math
import Rhino
import RhinoInside
import Grasshopper
import ghpythonlib.treehelpers as th
import Grasshopper.Kernel.Data.GH_Path as GH_Path
import Grasshopper.DataTree as DataTree
import scriptcontext
from RhinoInside.Revit import Revit, Convert
from Autodesk.Revit import DB
from Autodesk.Revit.DB.Structure import *
from System.Collections.Generic import List, IList
from System import Enum, Action

doc = Revit.ActiveDBDocument
if shape is not None:

    allRebarShape  = DB.FilteredElementCollector(doc).OfClass(DB.Structure.RebarShape).WhereElementIsElementType().ToElements()
    rebarShape = [rebarShape for rebarShape in allRebarShape if rebarShape.get_Parameter(DB.BuiltInParameter.ALL_MODEL_TYPE_NAME).AsString() == shape]
'''
for res in allRebarShape:
    print res.Id
    print doc.GetElement(res.Id).get_Parameter(DB.BuiltInParameter.ALL_MODEL_TYPE_NAME).AsString()
    
'''
# ---------- end getrebarshapebyname ----------
create_bars = GhPythonScript(host=graphical_element)  # -> results; inputs host: list, bar_curves: list, local_vec: list, quantity: list, pitch: list, rebar_types: list, shape_types: list, comment: list, run: Boolean
# ---------- create_bars: Python ----------
import rhinoscriptsyntax as rs

import clr
clr.AddReference('System.Core')
clr.AddReference('RhinoInside.Revit')
clr.AddReference('RevitAPI') 
clr.AddReference('RevitAPIUI')
import math
import Rhino
import RhinoInside
import Grasshopper
import ghpythonlib.treehelpers as th
import Grasshopper.Kernel.Data.GH_Path as GH_Path
import Grasshopper.DataTree as DataTree
import scriptcontext
from RhinoInside.Revit import Revit, Convert
from Autodesk.Revit import DB
from System.Collections.Generic import List, IList
from System import Enum, Action

class MyPreProcessor(DB.IFailuresPreprocessor):
    def PreprocessFailures(self, failuresAccessor):
        transactionName = failuresAccessor.GetTransactionName()
        failMessages = failuresAccessor.GetFailureMessages()
        
        if failMessages.Count == 0:
            return FailureProcessingResult.Continue

        for currentMessage in failMessages:
            failID = currentMessage.GetFailureDefinitionId()
            if failID == BuiltInFailures.OverlapFailures.DuplicateRebar:
                failuresAccessor.DeleteWarning(currentMessage)

            #failuresAccessor.ResolveFailure(currentMessage)
            #failuresAccessor.DeleteAllWarnings()	
            
        
        return FailureProcessingResult.Continue;

if run:
    doc = Revit.ActiveDBDocument
    bar_style = DB.Structure.RebarStyle.Standard
    hook_type = None
    
    hook_orient = DB.Structure.RebarHookOrientation.Right
    rebar_typeslist = rebar_types
    shape_typeslist = shape_types
    bar_curvelist = bar_curves
    local_veclist = local_vec
    
    curves = []
    norms = []
    shapes = []
    types = []
    rebars = []
    counts = []

    
    for i, line in enumerate(bar_curvelist):
        r_curve = Convert.Geometry.GeometryEncoder.ToCurve(line)
        curves.append([r_curve])
        norm = Convert.Geometry.GeometryEncoder.ToXYZ(local_veclist[i])
        norms.append(norm)
        type = rebar_typeslist[i]
        types.append(type)
        shape = shape_typeslist[i]
        shapes.append(shape)
    
    with DB.Transaction(doc, 'create_bars') as t:
        t.Start()
        
        failureOptions = t.GetFailureHandlingOptions()
        handler = MyPreProcessor()
        #failureOptions.SetFailuresPreprocessor(handler)
        t.SetFailureHandlingOptions(failureOptions)
        #OR exemple with GetFailureDefinitionId()
        #failureOptions.SetFailuresPreprocessor(DuplicateMarkSwallower())
        
        #2020
        #utid = DB.DisplayUnitType.DUT_MILLIMETERS
        
        for i,curve in enumerate(curves):
            
            #rebar = DB.Structure.Rebar.CreateFromCurvesAndShape(doc, shapes[i], types[i], hook_types[i], hook_types[i], host[0], norms[i], curve , hook_orient, hook_orient)
            #rebar = DB.Structure.Rebar.CreateFromCurvesAndShape(doc, shapes[i], types[i], hook_types_start[i], hook_types_end[i], host[0], norms[i], curve , hook_orient, hook_orient)
            rebar = DB.Structure.Rebar.CreateFromCurvesAndShape(doc, shapes[i], types[i], hook_type, hook_type, host[0], norms[i], curve , hook_orient, hook_orient)

            paraIndex = DB.BuiltInParameter.REBAR_SHAPE;
            param_shape = rebar.get_Parameter(paraIndex)
            param_shape.Set(shapes[i].Id)
            if comment:
                paraIndex = DB.BuiltInParameter.ALL_MODEL_MARK;
                param_comment = rebar.get_Parameter(paraIndex)
                param_comment.Set(comment[i])
            #paraIndex = DB.BuiltInParameter.REBAR_ELEM_HOOK_END_TYPE;
            #param_end = rebar.get_Parameter(paraIndex)
            #param_end.Set(hook_types_end[i].Id)
            #print(param)
            if  quantity and quantity[i]>1:
                space_feet = Convert.Geometry.GeometryEncoder.ToInternalLength(pitch[i])
                accessor = rebar.GetShapeDrivenAccessor()
                accessor.SetLayoutAsNumberWithSpacing(quantity[i],space_feet,True,True,True)
            
        if rebar.IsValidObject  :
            rebars.append(rebar.Id)
            
            
        
        t.Commit()
    results = rebars
# ---------- end create_bars ----------
crv = Curve(python_2.line)
crv_2 = Curve(python_5.line)
create_bars_2 = GhPythonScript()  # -> results; inputs host: list, bar_curves: list, local_vec: list, quantity: list, pitch: list, rebar_types: list, shape_types: list, comment: list, run: Boolean; same code as create_bars
crv_3 = Curve(python_4.line)
crv_4 = Curve(python_3.line)
crv_5 = Curve(python_6.line)
rebarshapeinfo = GhPythonScript(rebarShape=getrebarshapebyname.rebarShape)  # -> out, curves, orient0, orient1, angle1, angle2
# ---------- rebarshapeinfo: Python ----------
__author__ = "ykish"
__version__ = "2023.11.20"

import rhinoscriptsyntax as rs
import clr
clr.AddReference('RhinoInside.Revit')
clr.AddReference('System.Core')
clr.AddReference('RevitAPI') 
clr.AddReference('RevitAPIUI')
import RhinoInside.Revit.Convert.Geometry
clr.ImportExtensions(RhinoInside.Revit.Convert.Geometry)

curvesForBrowser = rebarShape.GetCurvesForBrowser()
curves = []
for line in curvesForBrowser:
    curve = line.ToCurve()
    curves.append(curve)

orient0 = rebarShape.GetDefaultHookOrientation(0);
orient1 = rebarShape.GetDefaultHookOrientation(1);

angle1 = rebarShape.GetDefaultHookAngle(0);
angle2 =rebarShape.GetDefaultHookAngle(1);
# ---------- end rebarshapeinfo ----------

# ----
# Color Format
# Input
data = Data(1)
# Method
data_2 = Data(1)
# Output
data_3 = Data(1)
# Display
data_4 = Data(1)
# Unuse
data_5 = Data(1)

item = ListItem(List=rebarshapeinfo.curves, Index=0, Wrap=True)  # -> Item, Item1, Item2
panel_8 = Panel(rebarshapeinfo.orient0)
panel_9 = Panel(rebarshapeinfo.angle2)
panel_10 = Panel(rebarshapeinfo.orient1)
panel_11 = Panel(rebarshapeinfo.angle1)
lng = ListLength(List=rebarshapeinfo.curves)
division = Division(A=Slider(425, range=0..1000), B=Slider(600, range=0..1000))
panel_12 = Panel(lng)
asin = ArcSine(Value=division)
rad = Radians(Degrees=asin)
crv_6 = Curve(item.Item1)  # disabled
crv_7 = Curve(item.Item)  # disabled
crv_8 = Curve(item.Item2)  # disabled
panel_13 = Panel(rebarshapeinfo.curves)
sin = Sine()
darc = DeconstructArc(Arc=crv_7)  # -> BasePlane, Radius, Angle; disabled
deg = Degrees(Radians=asin)
darc_2 = DeconstructArc(Arc=crv_6)  # -> BasePlane, Radius, Angle; disabled
darc_3 = DeconstructArc(Arc=crv_8)  # -> BasePlane, Radius, Angle; disabled
panel_14 = Panel(deg)
number_slider = Slider(180, range=0..1000)  # disabled
deg_2 = Degrees(Radians=darc_2.Angle)  # disabled
deg_3 = Degrees(Radians=darc_3.Angle)  # disabled
subtraction = Subtraction(A=number_slider, B=deg_2)
panel_15 = Panel(subtraction)
