# Grasshopper definition 20240205_createRebar_Columns.gh (Grasshopper 1.0.7)
# Copyright: GEL
# plug-ins: Bifocals, Rhino.Inside for Autodesk Revit

gallery = ImageGallery(CycleDelay=30, Randomize=False, UseLocalImages=True, UseRemoteImages=True)
create_rebar = BooleanToggle(False)

主筋 = Panel("ProgramInput_column_B1F-B2F_stirrup.csv")
csv = Panel("ProgramInput_column_B1F-B2F_mainbar.csv")
csv_2 = Panel("ProgramInput_column_B1F-B2F_horizontalties.csv")
ファルダ名 = Panel("data")
csv_3 = Panel("ProgramInput_column_B1F-B2F_verticalties.csv")

# ----
# Select Part
graphical_element = GraphicalElement(<structuralcolumn referenced from the Revit model>)

geometry = ElementGeometry(Elements=graphical_element)
xy = XYPlane(Origin=Point(0, 0, 0))
bbox = BoundingBox(Content=geometry, Plane=xy)  # -> Box, Box_2
python = GhPythonScript(folder_name=ファルダ名, main_line=主筋, x=Toggle(True))  # -> out, main_line_dir
# ---------- python: Python ----------
# -*- coding: utf-8 -*-
import os, sys
base_dir = os.path.dirname(ghdoc.Path)
main_line_dir = "{}//{}//{}".format(base_dir, folder_name,main_line)
# ---------- end python ----------

preview = CustomPreview(Geometry=geometry, Material=ColourSwatch(SwatchColor=RGBA(117, 33, 33, 34)))

# ----
# Color Format
# Input
data = Data(1)
# Method
data_2 = Data(1)
# Output
data_3 = Data(1)
# Display
data_4 = Data(1)
# Unuse
data_5 = Data(1)

gettopsurface = GetTopSurfaceFromBox(B=bbox.Box)
createdictionaryfromcsv = CreateDictionaryFromCSV(path=python.main_line_dir)  # -> out, dict
# ---------- createdictionaryfromcsv: Python ----------
__author__ = "ykish"
__version__ = "2023.11.28"


from utils.utils import dictionary_from_csv
dict = dictionary_from_csv(_path)
print(dict)
# ---------- end createdictionaryfromcsv ----------
X = UnitX(Factor=1)
get_curves_along_vector = GetCurvesAlongVector(B=gettopsurface, vec=X)  # -> B_2, A
crv = Curve(get_curves_along_vector.A)
crv_2 = Curve(get_curves_along_vector.B_2)
item = ListItem(List=crv, Index=0, Wrap=True)  # -> Item, Item1
item_2 = ListItem(List=crv_2, Index=0, Wrap=True)  # -> Item, Item1

preview_2 = CustomPreview(Geometry=crv_2, Material=ColourSwatch(SwatchColor=RGBA(80, 179, 204, 189)))

preview_3 = CustomPreview(Geometry=crv, Material=ColourSwatch(SwatchColor=RGBA(117, 33, 33, 34)))

createfacedictonary = CreateFaceDictonaryFromCurve(C=item_2.Item, C_2=item_2.Item1, C_3=item.Item, C_4=item.Item1)
createrebar = CreateRebar(
    host=graphical_element,
    face_dict_list=createfacedictonary,
    rebar_dict_list=createdictionaryfromcsv.dict,
    bake=create_rebar)  # -> out, planes, offset_planes, curves, offset_curves, elementIds; inputs face_dict_list: list, rebar_dict_list: list, bake: Boolean
# ---------- createrebar: Python ----------
__author__ = "ykish"
__version__ = "2023.11.30"
import Rhino.Geometry as rg
from geometry.geometry import create_plane_list_from_dict_list,create_offset_curves_tree_from_dict_list,offset_planes_from_dict
from rebar.rebar import create_rebars_from_dict_CAS,create_rebarShape_rhinoCurves_from_dict_list 


planes = create_plane_list_from_dict_list(_rebar_dict_list, _face_dict_list)
offset_planes = offset_planes_from_dict(planes, _rebar_dict_list, _face_dict_list)
curves = create_rebarShape_rhinoCurves_from_dict_list(_rebar_dict_list, offset_planes)
offset_curves = create_offset_curves_tree_from_dict_list(offset_planes, curves, _rebar_dict_list )

if _bake:
    elementIds = create_rebars_from_dict_CAS(_rebar_dict_list, offset_planes, _host)
# ---------- end createrebar ----------
checkrebardictionay = CheckRebarDictionay(face_dict=createfacedictonary)  # -> out, pt, x, y, z
# ---------- checkrebardictionay: Python ----------
__author__ = "ykish"
__version__ = "2023.11.28"

_dict = _face_dict
pt = _dict['Pt']
x = _dict['x']
y = _dict['y']
z = _dict['z']


print(_dict)
# ---------- end checkrebardictionay ----------
preview_4 = CustomPreview(Geometry=createrebar.offset_curves, Material=ColourSwatch(SwatchColor=RGB(117, 227, 0)))

# ==== cluster GetTopSurfaceFromBox: Extract top surface from box
B = ClusterInput()

debrep = DeconstructBrep(Brep=B)  # -> Faces, Edges, Vertices
evalsrf = EvaluateSurface(Surface=debrep.Faces, Point="{0.5,0.5,0.5}")  # -> Point, Normal, UDirection, VDirection, Frame

Z = UnitZ(Factor=1)
dprod = DotProduct(VectorA=evalsrf.Normal, VectorB=Z, Unitize=False)
equals = Equality(FirstNumber=dprod, SecondNumber="1")  # -> Equality, Inequality
dispatch = Dispatch(List=debrep.Faces, DispatchPattern=equals.Equality)  # -> ListA, ListB

geo = Geometry(dispatch.ListA)
geo_2 = ClusterOutput(geo)

# ==== cluster CreateFaceDictonaryFromCurve: Create Face Dictonary From Curve
C = ClusterInput()
C_2 = ClusterInput()
C_3 = ClusterInput()
C_4 = ClusterInput()
getvectorsfromcurve = GetVectorsFromCurve(C=C)  # -> pt_2, x_2, y_3, z_3
getvectorsfromcurve_2 = GetVectorsFromCurve(C=C_2)  # -> pt_2, x_2, y_3, z_3
getvectorsfromcurve_3 = GetVectorsFromCurve(C=C_3)  # -> pt_2, x_2, y_3, z_3
getvectorsfromcurve_4 = GetVectorsFromCurve(C=C_4)  # -> pt_2, x_2, y_3, z_3
python = GhPythonScript(index=1, Pt=getvectorsfromcurve.pt_2, x=getvectorsfromcurve.x_2, y=getvectorsfromcurve.y_3, z=getvectorsfromcurve.z_3)  # -> out, a; inputs Pt: Point3d, x: Vector3d, y: Vector3d, z: Vector3d
# ---------- python: Python ----------
__author__ = "ykish"
__version__ = "2023.11.30"

import rhinoscriptsyntax as rs

a= [{"i":index, "Pt":Pt, "x":x,"y":y,"z":z}]
# ---------- end python ----------
python_2 = GhPythonScript(
    index=2,
    Pt=getvectorsfromcurve_2.pt_2,
    x=getvectorsfromcurve_2.x_2,
    y=getvectorsfromcurve_2.y_3,
    z=getvectorsfromcurve_2.z_3)  # -> out, a; inputs Pt: Point3d, x: Vector3d, y: Vector3d, z: Vector3d; same code as python
python_3 = GhPythonScript(
    index=3,
    Pt=getvectorsfromcurve_3.pt_2,
    x=getvectorsfromcurve_3.x_2,
    y=getvectorsfromcurve_3.y_3,
    z=getvectorsfromcurve_3.z_3)  # -> out, a; inputs Pt: Point3d, x: Vector3d, y: Vector3d, z: Vector3d; same code as python
python_4 = GhPythonScript(
    index=4,
    Pt=getvectorsfromcurve_4.pt_2,
    x=getvectorsfromcurve_4.x_2,
    y=getvectorsfromcurve_4.y_3,
    z=getvectorsfromcurve_4.z_3)  # -> out, a; inputs Pt: Point3d, x: Vector3d, y: Vector3d, z: Vector3d; same code as python
merge = Merge(Data1=python.a, Data2=python_2.a, Data3=python_3.a, Data4=python_4.a)
R = ClusterOutput(merge)

# ==== cluster GetCurvesAlongVector: Get Curves Along Vector
B = ClusterInput()
vec = ClusterInput()
edges = BrepEdges(Brep=B)  # -> Naked, Interior, NonManifold
vec_2 = Vector(vec)
dprod = DotProduct(VectorA=edges.Naked, VectorB=vec_2, Unitize=True)
round = Round(Number=dprod)  # -> Nearest, Floor, Ceiling
equals = Equality(FirstNumber=round.Nearest, SecondNumber=Slider(0, range=0..100))  # -> Equality, Inequality
dispatch = Dispatch(List=edges.Naked, DispatchPattern=equals.Equality)  # -> ListA, ListB
B_2 = ClusterOutput(dispatch.ListB)
A = ClusterOutput(dispatch.ListA)

# ==== cluster GetVectorsFromCurve: Get X , Y and Z Vectors From Base Curve.
C = ClusterInput()
end = EndPoints(Curve=C)  # -> Start, End
Z = UnitZ(Factor=1)
neg = Negative(Value=Z)
vec2pt = Vector2Pt(PointA=end.Start, PointB=end.End, Unitize=True)  # -> Vector, Length
z = Vector(neg)
y = Vector(vec2pt.Vector)
xprod = CrossProduct(VectorA=y, VectorB=z, Unitize=False)  # -> Vector, Length
merge = Merge(Data1=flatten(y), Data2=flatten(xprod.Vector), Data3=flatten(z))
v = Vector(merge)
item = ListItem(List=v, Index=0, Wrap=True)  # -> Item, Item1, Item2
x = Vector(item.Item)
pt = Point(end.Start)
z_2 = Vector(item.Item2)
y_2 = Vector(item.Item1)
pt_2 = ClusterOutput(pt)
x_2 = ClusterOutput(x)
y_3 = ClusterOutput(y_2)
z_3 = ClusterOutput(z_2)
