# Grasshopper definition installer.gh (Grasshopper 1.0.7)
# plug-ins: Bifocals

gallery = ImageGallery(CycleDelay=30, Randomize=False, UseLocalImages=True, UseRemoteImages=True)
# RebarRIRToolkit
# Please specify the directory containing the 'RebarRIRToolkit' folder
path = FilePath("C:\Users\ykish\OneDrive\デスクトップ\RebarRIRToolkit\")
addpathtosys = GhPythonScript(folder_path=path, add_to_path=Toggle(False))  # -> out, message
# ---------- addpathtosys: Python ----------
"""Provides a scripting component.
    Inputs:
        folder_path: The directory path to add to sys.path.
        add_to_path: Boolean to control whether to add folder_path to sys.path.
    Output:
        message: A message about the action taken or not taken."""

import sys

if add_to_path:
    if folder_path not in sys.path:
        sys.path.append(folder_path)
        message = "Added '{}' to sys.path".format(folder_path)
    else:
        message = "'{}' already in sys.path".format(folder_path)
else:
    message = "Add to path is False. No action taken."
# ---------- end addpathtosys ----------
panel = Panel(path)
panel_2 = Panel(addpathtosys.message)

# ----
# Color Format
# Input
data = Data(1)
# Method
data_2 = Data(1)
# Output
data_3 = Data(1)
# Display
data_4 = Data(1)
# Unuse
data_5 = Data(1)
