# Grasshopper definition installer_RebarRIRToolkit.gh (Grasshopper 1.0.7)
# plug-ins: Bifocals

gallery = ImageGallery(CycleDelay=30, Randomize=False, UseLocalImages=True, UseRemoteImages=True)

# ----
# Dowonload Python Code From Github
button = Button()
python = GhPythonScript(b=button)  # -> out, a; disabled
# ---------- python: Python ----------
__author__ = "ykish"
__version__ = "2023.10.02"

import System
import urllib
import zipfile
import os

def download_github_repo_as_zip(repo_url):
    # GitHubのリポジトリURLからZIPファイルのURLを生成
    zip_url = repo_url.rstrip('/') + '/archive/refs/heads/main.zip'
    
    # ZIPファイルをダウンロード
    response = urllib.urlopen(zip_url)
    data = response.read()
    
    # 指定の場所にZIPファイルを保存 C:\Users\[ユーザー名]\AppData\Local\GEL\RebarTool
    appdata_local = System.Environment.GetFolderPath(System.Environment.SpecialFolder.LocalApplicationData)
    gel_rebartool_directory = os.path.join(appdata_local, 'GEL', 'RebarTool')
    if not os.path.exists(gel_rebartool_directory):
        os.makedirs(gel_rebartool_directory)
    filename = "repository.zip"
    save_path = os.path.join(gel_rebartool_directory, filename)
    with open(save_path, 'wb') as file:
        file.write(data)
    return save_path, gel_rebartool_directory;

def unzip_file(zip_filepath, dest_dir):
    """
    ZIPファイルを解凍する関数

    Parameters:
    - zip_filepath: 解凍するZIPファイルのパス
    - dest_dir: 解凍したファイルを保存するディレクトリのパス
    """
    with zipfile.ZipFile(zip_filepath, 'r') as zip_ref:
        zip_ref.extractall(dest_dir)

# 使用例
repo_url = "https://github.com/GEL-Dev/RebarToolRIR" # Python 2ではraw_inputを使用""
save_path,gel_rebartool_directory = download_github_repo_as_zip(repo_url)
unzip_file(save_path,gel_rebartool_directory )
# ---------- end python ----------

# ---- group: GhPython Script
rtinstall = RebarToolkitInstaller(install=Toggle(False))  # -> out, message
# ---------- rtinstall: Python ----------
__author__ = "ykish"
__version__ = "2023.11.24"


ghenv.Component.Name = 'RebarToolkit Installer'
ghenv.Component.NickName = 'RTInstall'

ghenv.Component.Category = 'RebarToolkit'
ghenv.Component.SubCategory = '1 :: Version'
ghenv.Component.AdditionalHelpFromDocStrings = '0'

import clr
clr.AddReference("System.Net")
import os
import io
import subprocess
import System.Net
import System.Windows.Forms
import shutil
from distutils import dir_util
import Rhino
from Rhino.RhinoApp import Version as RHINO_VERSION
from Grasshopper.Folders import UserObjectFolders, DefaultAssemblyFolder
from Grasshopper.Kernel import GH_RuntimeMessageLevel as Message
from System import Array
from System.Net import WebClient
from System.IO import Path, Directory
import zipfile
import json

def get_latest_release_zip_url(repo):
    """GitHubのAPIを使用して最新のリリースのZIPファイルのURLを取得する"""
    api_url = "https://api.github.com/repos/{}/releases/latest".format(repo)
    client = WebClient()
    client.Headers.Add("User-Agent", "request")
    release_info = client.DownloadString(api_url)
    release_data = json.loads(release_info)
    return release_data["zipball_url"]
    
def download_zip_from_url(url, save_dir):
    """指定されたURLからZIPファイルをダウンロードし、指定されたディレクトリに保存する"""
    client = WebClient()
    client.Headers.Add("User-Agent", "request")
    filename = os.path.join(save_dir, "latest_release.zip")
    client.DownloadFile(url, filename)
    return filename

def unzip_file(zip_filepath, dest_dir, folders_to_extract, specific_destinations):
    with zipfile.ZipFile(zip_filepath, 'r') as zip_ref:
        for item in zip_ref.infolist():
            path_parts = item.filename.split('/')
            # 2番目のフォルダ名を取得（トップレベルフォルダが1つのみの場合）
            second_level_folder = path_parts[1] if len(path_parts) > 1 else None

            # 2番目のフォルダが特定のフォルダに属する場合、適切なディレクトリに解凍
            if second_level_folder in folders_to_extract:
                destination = specific_destinations.get(second_level_folder, dest_dir)

                # 完全な解凍先のパスを生成
                full_path = os.path.join(destination, *path_parts[1:])

                # ディレクトリの作成
                if item.filename.endswith('/') and not os.path.isdir(full_path):
                    print(full_path)
                    os.makedirs(full_path)
                # ファイルの解凍
                elif not item.filename.endswith('/'):
                    # 解凍先ディレクトリが存在しない場合は作成
                    if not os.path.exists(os.path.dirname(full_path)):
                        os.makedirs(os.path.dirname(full_path))
                    # 元のフォルダ構造を無視して特定のパスにファイルを解凍
                    with zip_ref.open(item) as source, open(full_path, 'wb') as target:
                        shutil.copyfileobj(source, target)

    # ZIPファイルの解凍が完了した後、特定のフォルダ名を変更
    if 'userObjects' in folders_to_extract:
        original_path = os.path.join(specific_destinations['userObjects'], 'userObjects')
        new_path = os.path.join(specific_destinations['userObjects'], "RebarToolkit")
        if os.path.exists(original_path) and not os.path.exists(new_path):
            os.rename(original_path, new_path)
    os.remove(zip_filepath)
    
    
    
if _install:
    # リポジトリのユーザー名/名前
    repo = "GEL-Dev/RebarRIRToolkit"
    
    # 保存するディレクトリ
    save_dir = os.path.join(os.environ["LOCALAPPDATA"], "GEL", "RebarToolkit")
    if not os.path.exists(save_dir):
        os.makedirs(save_dir)
        
    
    # 最新のリリースZIPのURLを取得
    latest_release_url = get_latest_release_zip_url(repo)
    print(latest_release_url)
    ver = latest_release_url.split('/')[-1].lstrip('v')
    ghenv.Component.Message = ver
    
    userObject_dir =""
    for folder in UserObjectFolders:
        if "UserObjects" in folder:
            print (folder)
            userObject_dir = folder
    
    folders_to_extract = {'my_package', 'gh_scripts', 'data','userObjects'}
    specific_destinations = {
        'my_package': save_dir,
        'gh_scripts': save_dir,
        'data':save_dir,
        'userObjects': userObject_dir
    }
    # ZIPファイルをダウンロードして解凍
    zip_path = download_zip_from_url(latest_release_url, save_dir)
    #print(zip_path)
    unzip_file(zip_path, save_dir,folders_to_extract,specific_destinations)
    
    my_package_dir = os.path.join(save_dir,"my_package")
    #print(my_package_dir)


    current_paths = list(Rhino.Runtime.PythonScript.SearchPaths)
    new_path =  os.path.join(save_dir,"my_package")
    if new_path not in current_paths:
        current_paths.append(new_path)
        Rhino.Runtime.PythonScript.SearchPaths = Array[str](current_paths)
    print(Rhino.Runtime.PythonScript.SearchPaths)
# ---------- end rtinstall ----------

# ----
python_2 = GhPythonScript(uninstall=Toggle(False))  # -> out, message; inputs uninstall: Boolean
# ---------- python_2: Python ----------
__author__ = "ykish"
__version__ = "2023.11.28"

import clr
import os
import shutil
clr.AddReference("System")
from System import Array
import Rhino

def remove_directory(path):
    """ Remove a directory and all its contents """
    if os.path.exists(path):
        shutil.rmtree(path)
        message = "Removed directory: {}".format(path)
    else:
        message = "Directory not found: {}".format(path)
    return message

def remove_from_python_search_paths(path):
    """ Remove a path from Rhino's Python script search paths """
    current_paths = list(Rhino.Runtime.PythonScript.SearchPaths)
    if path in current_paths:
        current_paths.remove(path)
        Rhino.Runtime.PythonScript.SearchPaths = Array[str](current_paths)
        message = "Removed from Python search paths: {}".format(path)
    else:
        message = "Path not found in Python search paths: {}".format(path)
    return message


if _uninstall:
    message =[]
    print("start uninstall")
    save_dir = os.path.join(os.environ["LOCALAPPDATA"], "GEL", "RebarToolkit")
    message.append(remove_directory(save_dir))
    package_dir= os.path.join(save_dir,'my_package')
    message.append(remove_from_python_search_paths(package_dir))
# ---------- end python_2 ----------
panel = Panel(rtinstall.message)
b = Slider(6405, range=0..10000)

# ----
# Color Format
# Input
data = Data(1)
# Method
data_2 = Data(1)
# Output
data_3 = Data(1)
# Display
data_4 = Data(1)
# Unuse
data_5 = Data(1)

python_3 = GhPythonScript()  # -> out, a; unedited script template
python_4 = GhPythonScript(name="rg01", a=Slider(4341, range=0..10000), b=b)  # -> out, line; inputs plane: Plane
# ---------- python_4: Python ----------
"""Provides a scripting component.
    Inputs:
        a: length of line
        b: length of line
        plane: The base plane
    Output:
        line: The line"""

import Rhino.Geometry as rg
from rebar.rebarShape import RebarShapeCurve

rb = RebarShapeCurve(name,plane,a,b,c,d,e,f,g,h,x,y,j)
line = rb.curve
# ---------- end python_4 ----------
crv = Curve(python_4.line)
