# Grasshopper definition testPaht.gh (Grasshopper 1.0.7)
# plug-ins: Bifocals

gallery = ImageGallery(CycleDelay=30, Randomize=False, UseLocalImages=True, UseRemoteImages=True)
# Covert Revt Check
number_slider = Slider(300, range=0..1000)
pt = ConstructPoint(XCoordinate=0, YCoordinate=number_slider, ZCoordinate=0)
pt_2 = ConstructPoint(XCoordinate=0, YCoordinate=Slider(116, range=0..1000), ZCoordinate=0)
pt_3 = ConstructPoint(XCoordinate=0, YCoordinate=0, ZCoordinate=0)
ln = Line(StartPoint=pt_3, EndPoint=pt)
pline = PolyLine(Vertices=[pt_3, pt, pt_2], Closed=False)
cir = Circle(Plane=PlaneXY(0, 0, 0), Radius=1)
python = GhPythonScript(x=pt_3, y=ln, z=pline, u=cir)  # -> out, a; inputs x: Point3d, y: Line, z: Polyline
# ---------- python: Python ----------
# -*- coding: utf-8 -*-
import importlib
import my_package
reload(my_package)

from my_package.utils.rhinoinside_utils import get_active_doc, get_active_ui_doc, convert_rhino_to_revit_geometry

doc = get_active_doc()
uidoc = get_active_ui_doc()


a = convert_rhino_to_revit_geometry(z)
# ---------- end python ----------

# ----
# Color Format
# Input
data = Data(1)
# Method
data_2 = Data(1)
# Output
data_3 = Data(1)
# Display
data_4 = Data(1)
# Unuse
data_5 = Data(1)

path = FilePath("C:\Users\ykish\Documents\GitHub\RebarRIRToolkit\")
panel = Panel(path)
addpathtosys = GhPythonScript(folder_path=path)  # -> out, message
# ---------- addpathtosys: Python ----------
"""Provides a scripting component.
    Inputs:
        folder_path: string The directory path to add to sys.path.
        add_to_path: boool Boolean to control whether to add folder_path to sys.path.
    Output:
        message: A message about the action taken or not taken."""

import os
import sys

new_path = folder_path

python_path = os.environ.get('REBARRIRTOOLPATH', '')

if new_path not in python_path:
    
    os.environ['REBARRIRTOOLPATH'] = new_path
    sys.path.append(new_path)

message = sys.path
# ---------- end addpathtosys ----------
panel_2 = Panel(addpathtosys.message)
