# Grasshopper definition test_readcsv.gh (Grasshopper 1.0.7)
# plug-ins: Bifocals

gallery = ImageGallery(CycleDelay=30, Randomize=False, UseLocalImages=True, UseRemoteImages=True)
path = FilePath("G:\Shared drives\Development\100_Projects\0011_SZ_RibarTools\08_InternalWorkFolder\Wall2\New folder\ProgramInput_D-wall_Mainbar.csv")

# ---- group: RebarToolkit Uninstaller
rtuninstall = RebarToolkitInstaller()  # -> out, message; inputs uninstall: Boolean
# ---------- rtuninstall: Python ----------
__author__ = "ykish"
__version__ = "2023.11.28"

ghenv.Component.Name = 'RebarToolkit Installer'
ghenv.Component.NickName = 'RTUninstall'

ghenv.Component.Category = 'RebarToolkit'

import clr
import os
import shutil
clr.AddReference("System")
from System import Array
import Rhino

def remove_directory(path):
    """ Remove a directory and all its contents """
    if os.path.exists(path):
        shutil.rmtree(path)
        message = "Removed directory: {}".format(path)
    else:
        message = "Directory not found: {}".format(path)
    return message

def remove_from_python_search_paths(path):
    """ Remove a path from Rhino's Python script search paths """
    current_paths = list(Rhino.Runtime.PythonScript.SearchPaths)
    if path in current_paths:
        current_paths.remove(path)
        Rhino.Runtime.PythonScript.SearchPaths = Array[str](current_paths)
        message = "Removed from Python search paths: {}".format(path)
    else:
        message = "Path not found in Python search paths: {}".format(path)
    return message


if _uninstall:
    message =[]
    print("start uninstall")
    save_dir = os.path.join(os.environ["LOCALAPPDATA"], "GEL", "RebarToolkit")
    message.append(remove_directory(save_dir))
    package_dir= os.path.join(save_dir,'my_package')
    message.append(remove_from_python_search_paths(package_dir))
# ---------- end rtuninstall ----------

# ----
python = GhPythonScript(path=path)  # -> out, a
# ---------- python: Python ----------
__author__ = "ykish"
__version__ = "2023.11.28"
import os
import rhinoscriptsyntax as rs
import csv
from rebar.rebarShape import RebarShapeCurve
def dictionary_from_csv(csv_path):
    """Read a CSV file and return a list of dictionaries of its contents."""
    with open(csv_path, 'r') as csv_file:
        # csv.DictReaderを使用してCSVファイルを読み込む
        dict_list = [row for row in csv.DictReader(csv_file)]
    return dict_list

csv_path = os.path.abspath(_path)
print(csv_path)
dict_list = dictionary_from_csv(csv_path)
print(dict_list)

shapes = [item['shape'] for item in dict_list]
print(shapes)

params_template = {'a': None, 'b': None, 'c': None, 'd': None, 'e': None, 'f': None, 'g': None, 'h': None, 'x': None, 'y': None, 'j': None}

updated_params_list = []
for d in dict_list:
    updated_params = params_template.copy()
    for key in updated_params:
        if key in d:
            if d[key] =="":
                updated_params[key] = None
            else:
                updated_params[key] = d[key]
    updated_params_list.append(updated_params)
def update_params_from_dict_list(dict_list, params_template):

    updated_params_list = []
    for d in dict_list:
        updated_params = params_template.copy()
        for key in updated_params:
            if key in d:
                updated_params[key] = None if d[key] == "" else d[key]
        updated_params_list.append(updated_params)
    
    return updated_params_list
    
def create_rebarShapeParams_from_csv(csv_path):
    dict_list = dictionary_from_csv(csv_path)
    params_template = {'a': None, 'b': None, 'c': None, 'd': None, 'e': None, 'f': None, 'g': None, 'h': None, 'x': None, 'y': None, 'j': None}
    updated_params_list = update_params_from_dict_list(dict_list, params_template)
    return updated_params_list

def create_rebarShape_from_csv(csv_path):
    params_list = create_rebarShapeParams_from_csv(csv_path)
    print(params_list[0])
    dict_list = dictionary_from_csv(csv_path)
    name_list = [d['name'] for d in dict_list]
    rebarShape_list = []
    for dict, i in enumerate(dict_list):
        rgType = "rg01"
        rebarShape_list.append(RebarShapeCurve(rgType, plane=None,**params_list[i]))
    return rebarShape_list
    
    

create_rebarShape_from_csv(csv_path)
# ---------- end python ----------

# ----
# Color Format
# Input
data = Data(1)
# Method
data_2 = Data(1)
# Output
data_3 = Data(1)
# Display
data_4 = Data(1)
# Unuse
data_5 = Data(1)
